# Dynamo graph Auto Door Schedules.dyn (Dynamo 2.6.1.8786)
# packages: Genius Loci 2021.1.12, archi-lab.net 2020.23.13

views = Views()  # nothing selected
code_block = CodeBlock { 3; }
sequence = Sequence(step=code_block)
byCoordinates = Point.ByCoordinates(x=sequence)
create_legend_component = Custom[Create Legend Component](view=views, location=byCoordinates)  # package Genius Loci; Inserts a new legend component by duplicating an existing in the given legend view. Please note : At least one legend component must be placed in the legend view.; unwired: familyType
family_types = FamilyTypes("SABER_Glass Door_00:800 x 2400")
select_model_elements = DSModelElementsSelection()  # 2 picked in the model
deconstruct = List.Deconstruct(list=select_model_elements@L2, lacing=Longest)
geometry = Element.Geometry(element=deconstruct.first)
centroid = Solid.Centroid(solid=geometry)
categories = Categories("OST_Doors")
all_elements_of_category = ElementsOfCategory(Category=categories)
elementType = Element.ElementType(element=all_elements_of_category)
uniqueItems = List.UniqueItems(list=elementType)
boolean = BoolSelector(false)
clean = List.Clean(list=uniqueItems, preserveIndices=boolean)
code_block_2 = CodeBlock { "Width"; }
getParameterValueByName = Element.GetParameterValueByName(element=clean, parameterName=code_block_2)
code_block_3 = CodeBlock { 0.900; }
eq = Equals(x=getParameterValueByName, y=code_block_3)
filterByBoolMask = List.FilterByBoolMask(list=clean, mask=eq)
name = Element.Name(element=filterByBoolMask.in)
sortByKey = List.SortByKey(list=filterByBoolMask.in, keys=name)
watch = Watch(sortByKey.sorted_list)
count = List.Count(list=watch)
code_block_4 = CodeBlock { 3; }
code_block_5 = CodeBlock(COUNT=count, SPACING=code_block_4) { (COUNT-1)*(SPACING*-1); (COUNT-1); }
translate = Geometry.Translate(geometry=centroid, xTranslation=code_block_5.out0)
byStartPointEndPoint = Line.ByStartPointEndPoint(startPoint=centroid, endPoint=translate)
pointsAtEqualSegmentLength = Curve.PointsAtEqualSegmentLength(curve=byStartPointEndPoint, divisions=code_block_5.out1)
legend_settings = Custom[Legend Settings]()  # package archi-lab.net; This node sets all settings for the Legend display with Analysis Visualization Framework of Revit.; unwired: showLegend, showUnits, showName, headingTextTypeId, bodyTextTypeId, showDataDescription, rounding, graphHeight, graphWidth, graphSteps
legend_settings_2 = Custom[Legend Settings]()  # unwired: showLegend, showUnits, showName, headingTextTypeId, bodyTextTypeId, showDataDescription, rounding, graphHeight, graphWidth, graphSteps
views_2 = Views("00_Test")
code_block_6 = CodeBlock { Point.ByCoordinates(0,0); }
create_legend_component_2 = Custom[Create Legend Component](view=views_2, familyType=elementType, location=code_block_6)
views_3 = Views("00_Test")
categories_2 = Categories("OST_Doors")
all_elements_of_category_2 = ElementsOfCategory(Category=categories_2)
elementType_2 = Element.ElementType(element=all_elements_of_category_2)
uniqueItems_2 = List.UniqueItems(list=elementType_2)
boolean_2 = BoolSelector(false)
clean_2 = List.Clean(list=uniqueItems_2, preserveIndices=boolean_2)

# group: Verify Parameter
code_block_7 = CodeBlock { "Width"; }

getParameterValueByName_2 = Element.GetParameterValueByName(element=clean_2, parameterName=code_block_7)
count_2 = List.Count(list=getParameterValueByName_2)
number_slider = DoubleSlider(0.5, range=0..100 step 0.1)
sequence_2 = Sequence(amount=count_2, step=number_slider)
code_block_8 = CodeBlock(x=sequence_2) { Point.ByCoordinates(x,0); "Center"; TextNoteType.ByName("1.35mm Montserrat Blue"); }
string_from_object = FromObject(obj=getParameterValueByName_2)
code_block_9 = CodeBlock(x=code_block_7, y=string_from_object) { x+ " = "+ y; }
byLocation = TextNote.ByLocation(view=views_3, location=code_block_8.out0, text=code_block_9, alignment=code_block_8.out1, type=code_block_8.out2)
code_block_10 = CodeBlock { "TTestk"; }
count_3 = List.Count(list=sequence_2)
cycle = List.Cycle(list=code_block_10, amount=count_3)
watch_2 = Watch(cycle)
byCoordinates_2 = Point.ByCoordinates(x=sequence_2)
