# Dynamo graph Data_Shape_Test.dyn (Dynamo 2.6.1.8786)
# packages: Data-Shapes 2021.2.1

code_block = CodeBlock { 0; 1; 2; 3; }
list_create = List.Create(item0=code_block.out0, item1=code_block.out1, item2=code_block.out2, item3=code_block.out3)
boolean = BoolSelector(false)
multipleinputform = Custom[MultipleInputForm ++](Inputs=list_create, Toggle=boolean)  # package Data-Shapes; Create a form with multiple inputs. see www.data-shapes.net for tutorials and infos!
