# Dynamo graph Dynamo Learning.dyn (Dynamo 2.6.1.8786)
# packages: archi-lab.net 2020.23.13, Clockwork for Dynamo 2.x 2.4.0

wall_location = WallLocation("WallCenterline")
curve = Grid.Curve()  # unwired: grid
code_block = CodeBlock(test=curve) { test; }

# group: Get Dimension Types
element_types = ElementTypes("DimensionType")
all_elements_of_type = ElementsOfType(element_type=element_types)

name = Element.Name(element=all_elements_of_type)
string = StringInput("SABER Dot - 1.85mm Montserrat")
indexOf = List.IndexOf(list=name, element=string)
getItemAtIndex = List.GetItemAtIndex(list=all_elements_of_type, index=indexOf)
code_block_2 = CodeBlock { 1..50..5; }
watch = Watch(code_block_2)
categories = Categories("OST_Grids")
all_elements_of_category = ElementsOfCategory(Category=categories)
name_2 = Element.Name(element=all_elements_of_category)
toNumber = String.ToNumber(str=name_2)

# group: Changes the Data Type
type = Object.Type(obj=toNumber)

countOccurences = Custom[List.CountOccurences](seq=name_2)  # package Clockwork for Dynamo 2.x; Counts the number of occurences of each unique element in a given list
code_block_3 = CodeBlock { 2; }
chop = List.Chop(list=name_2, lengths=code_block_3)
string_2 = StringInput("Walls")
byName = Category.ByName(name=string_2)
all_elements_of_category_2 = ElementsOfCategory(Category=byName)
string_3 = StringInput("Length")
getParameterValueByName = Element.GetParameterValueByName(element=all_elements_of_category_2, parameterName=string_3)
length = Watch(getParameterValueByName)
string_4 = StringInput("Area")
getParameterValueByName_2 = Element.GetParameterValueByName(element=all_elements_of_category_2, parameterName=string_4)
area = Watch(getParameterValueByName_2)
clear_list = Custom[Clear List](input=toNumber)  # package archi-lab.net; This node will remove all Null and Empty Lists from any list.
string_from_object = FromObject(obj=clear_list)
indexOf_2 = List.IndexOf(list=name_2, element=string_from_object)
list_create = List.Create(item0=all_elements_of_category_2)
list_create_2 = List.Create(item0=list_create)
code_block_4 = CodeBlock { 0; }
getItemAtIndex_2 = List.GetItemAtIndex(index=code_block_4)  # unwired: list
map = List.Map(list=list_create_2, f_x=getItemAtIndex_2)
