# Grasshopper definition FABRICATION TEST.gh (Grasshopper 1.0.7)
# plug-ins: Karamba3D, Kangaroo2 Components

crv = Curve([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])
crv_2 = Curve([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])
mesh = Mesh(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)

refine = Refine(Mesh=mesh, Level=Slider(2, range=0..10))
mesh_2 = Mesh(refine)
license = LicenseKaramba3D()
nv = NakedVertices(Mesh=mesh_2)  # -> ClothedIndex, NakedIndex, ClothedPts, NakedPts
demesh = DeconstructMesh(Mesh=mesh_2)  # -> Vertices, Faces, Colours, Normals
panel = Panel(license)
pt = Point(nv.NakedPts)
pull = PullPoint(Point=pt, Geometry=crv, ClosestOnly=True)  # -> ClosestPoint, Distance
smaller = SmallerThan(FirstNumber=pull.Distance, SecondNumber=Slider(0.001, range=0..0.001))  # -> SmallerThan, OrEqualTo
dispatch = Dispatch(List=pt, DispatchPattern=smaller.OrEqualTo)  # -> ListA, ListB
pt_2 = Point(dispatch.ListA)
clean = CleanTree(RemoveNulls=True, RemoveInvalid=True, RemoveEmpty=invert(False), Tree=pt_2)
edgelengths = EdgeLengths(Mesh=mesh_2, LengthFactor=Slider(1.3, range=0..10), Strength=Slider(1000, range=0..1000))
anchor = Anchor(Point=pt_2, Strength=Slider(1000, range=0..1000))
viewer = ParamViewer(clean)
load = Load(Point=demesh.Vertices, ForceVector=Vector(0, 0, 1), Weighting=1)
show = Show(G=mesh_2)
merge = Merge(Data1=show, Data2=edgelengths, Data3=anchor, Data4=load)  # -> flatten(Result)
zombiesolver = ZombieSolver(GoalObjects=merge, Threshold=1e-10, Tolerance=0.01, MaxIterations=50000)  # -> I, V, O
bouncysolver = BouncySolver(
    GoalObjects=merge,
    Reset=Button(),
    Threshold=1e-15,
    Tolerance=0.01,
    Damping=Slider(0.97, range=0..1),
    Iterations=Slider(100, range=0..10000),
    On=Toggle(True))  # -> I, V, O
item = ListItem(List=zombiesolver.O, Index=0, Wrap=True)
support = SupportKaramba3D()
mesh_3 = Mesh(item)
supp = SupportKaramba3D(PosInd=pt_2, menu=[buttons(on, on, on, on, on, on)])
meshtoshell = MeshToShellKaramba3D(Mesh=mesh_3, LimitDistance_m=0.005)  # -> Element, Points, Info
assemble = AssembleModelKaramba3D(Elem=meshtoshell.Element, LimitDistance_m=0.005)  # -> Model, Info, Mass_kg, CenterOfGravity, LoadCaseNames
