# Grasshopper definition GXU COMM.gh (Grasshopper 1.0.7)
# plug-ins: Rhino.Inside for Autodesk Revit, Bifocals

# ----
# Building Core
list = ValueList({"Scheme 1": 0, "Scheme 2": 1, "Scheme 3": 2}, selected="Scheme 1")
md_slider = MDSlider(
    SliderMode=0,
    slider_value=Point(0.3074556676, 0.5047719072, 0.5),
    x_domain=Domain(0, 1),
    y_domain=Domain(0, 1),
    z_domain=Domain(0, 1))
filter = StreamFilter(Gate=list, Stream0="9.200", Stream1="8.400", Stream2="13.340")
filter_2 = StreamFilter(Gate=list, Stream0="14.120", Stream1="20.120", Stream2="13.340")

categories = BuiltInCategories("autodesk.revit.category.local:siteProperty-1.0.0", LayoutLevel=2, SearchPattern="Property")

# ----
# Building Parameters
front_setback = Slider(10, range=0..15)
driveway = Slider(8, range=0..15)
ground_floor_height = Slider(3.5, range=0..10)
podium_height = Slider(4.5, range=3..9)
podium_floors = Slider(2, range=1..8)
building_height = Slider(3.5, range=3..9)
total_floors = Slider(12, range=1..20)
corridor = Slider(1.45, range=0..10)
commercial_floors_count = Slider(6, range=0..10)
number_of_basements = Slider(1, range=1..6)

# ---- group: Building Form
geo = Geometry(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)

# ----
# Building Form
pipeline = GeometryPipeline(
    GroupByLayer=False,
    GroupByType=False,
    IncludeHidden=True,
    IncludeLocked=True,
    LayerFilter="0_FORM",
    NameFilter="*",
    SublayerFiltering=True,
    TypeFilter=1073741884)
mesh = Mesh(geo)
faceb = FaceBoundaries(Mesh=mesh)
boundary = BoundarySurfaces(Edges=faceb)
join = BrepJoin(Breps=boundary)  # -> Breps, Closed
medges = MeshEdges(Mesh=geo)  # -> NakedEdges, InteriorEdges, NonManifoldEdges
brep = Brep(join.Breps)

catfltr = CategoryFilter(Categories=categories, Inverted=False)
expression = Expression(x=total_floors, Expression="x-1")

mesh_2 = Mesh(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)
mesh_3 = Mesh(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)
mesh_4 = Mesh(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)

elements = QueryElements(Filter=catfltr, Limit=100)  # -> Elements, Count
geo_2 = Geometry([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])

# ----
# Delete after fix
panel = Panel("{0,0,-0.5}")
move = Move(Geometry=geo_2, Motion=panel)  # -> Geometry, Transform

geometry = ElementGeometry(Elements=elements.Elements)
boundary_2 = BoundarySurfaces(Edges=move.Geometry)

# ----
# Base Footprint
crv = Curve(move.Geometry)
explode = Explode(Curve=crv, Recursive=True)  # -> flatten(Segments), flatten(Vertices)
item = ListItem(List=explode.Segments, Index=0, Wrap=True)  # -> Item, Item1, Item2, Item3
offset = OffsetCurve(Curve=item.Item, Distance=front_setback, Corners=1)
item_2 = ListItem(List=explode.Vertices, Index=0, Wrap=True)  # -> Item, Item1, Item2, Item3, Item4
ext = ExtendCurve(Curve=offset, Type=0, Start="2", End="2")
ccx = CurveCurve(CurveA=[item.Item1, item.Item2, item.Item3], CurveB=ext)  # -> Points, ParamsA, ParamsB
item_3 = ListItem(List=flatten(ccx.Points), Index=0, Wrap=True)  # -> Item, Item1
merge = Merge(Data1=item_3.Item, Data2=item_3.Item1, Data3=item_2.Item4, Data4=item_2.Item2)
intcrv = Interpolate(Vertices=merge, Degree=1, Periodic=invert(False), KnotStyle=1)  # -> Curve, Length, Domain

# ----
# Defining Floor Height Values Catalogue
series = Series(Start=ground_floor_height, Step=podium_height, Count=podium_floors)  # -> flatten(Series)
item_4 = ListItem(List=series, Index=0, Wrap=True)  # -> Item1, Item
expression_2 = Expression(x=podium_floors, y=expression, Expression="y-x")
addition = Addition(A=item_4.Item1, B=podium_height)
series_2 = Series(Start=addition, Step=building_height, Count=expression_2)  # -> flatten(Series)
merge_2 = Merge(Data1="0", Data2=series)
merge_3 = Merge(Data1=merge_2, Data2=series_2)
pt = ConstructPoint(XCoordinate=0, YCoordinate=0, ZCoordinate=merge_3)
panel_2 = Panel(merge_3)

area = Area(Geometry=intcrv.Curve)  # -> Area, Centroid
panel_3 = Panel(area.Area)

parapet = Panel("2")
item_5 = ListItem(List=merge_3, Index=podium_floors, Wrap=True)
offset_2 = OffsetCurve(Curve=offset, Distance=Slider(40, range=10..60), Corners=1)
addition_2 = Addition(A=item_5, B=parapet)
Z = UnitZ(Factor=item_5)
Z_2 = UnitZ(Factor=addition_2)
extr = Extrude(Base=offset_2, Direction=Z_2)
move_2 = Move(Geometry=intcrv.Curve, Motion=Z)  # -> Geometry, Transform
area_2 = Area(Geometry=extr)  # -> Area, Centroid
extr_2 = Extrude(Base=intcrv.Curve, Direction=Z_2)
scale = Scale(Geometry=extr, Center=area_2.Centroid, Factor=Slider(1.5, range=0..10))  # -> Geometry, Transform
cap = CapHoles(Brep=extr_2)
move_3 = Move(Geometry=cap, Motion="{0,0,0.5}")  # -> Geometry, Transform
sdiff = SolidDifference(BrepsA=move_3.Geometry, BrepsB=scale.Geometry)

# ----
# Basement Parking
series_3 = Series(Start=0, Step=podium_height, Count=number_of_basements)  # -> flatten(Series)
expression_3 = Expression(x=series_3, Expression="x*-1")  # -> reverse(R)
pt_2 = ConstructPoint(XCoordinate=0, YCoordinate=0, ZCoordinate=expression_3)
move_4 = Move(Geometry=intcrv.Curve, Motion="{0,0,0.5}")  # -> Geometry, Transform
item_6 = ListItem(List=pt_2, Index=0, Wrap=True)  # -> Item1, Item
lng = ListLength(List=series_3)
boundary_3 = BoundarySurfaces(Edges=move_4.Geometry)
expression_4 = Expression(x=lng, y=item_6.Item, Expression="if(x≤1,{0,0,-0.5},y+{0,0,-1.5})")
extr_3 = Extrude(Base=boundary_3, Direction=expression_4)
sint = SolidIntersection(BrepsA=move_3.Geometry, BrepsB=scale.Geometry)  # -> flatten(Result)
cap_2 = CapHoles(Brep=extr_3)
merge_4 = Merge(Data1=series, Data2=merge_3)
pt_3 = ConstructPoint(XCoordinate=0, YCoordinate=0, ZCoordinate=merge_4)
join_2 = BrepJoin(Breps=[sint, cap_2])  # -> Breps, Closed
merge_5 = Merge(Data1=pt_2, Data2=pt_3)
sunion = SolidUnion(Breps=join_2.Breps)

offset_3 = OffsetCurve(Curve=item.Item3, Distance=driveway, Corners=1)

evalsrf = EvaluateSurface(Surface=reparameterize(boundary_2), Point=md_slider)  # -> Point, Normal, UDirection, VDirection, Frame
pdecon = Deconstruct(Point=evalsrf.Point)  # -> XComponent, YComponent, ZComponent
addition_3 = Addition(A=pdecon.YComponent, B=filter_2)
addition_4 = Addition(A=pdecon.XComponent, B=filter)
item_7 = ListItem(List=merge_3, Index=0, Wrap=True)  # -> Item1, Item
pt_4 = ConstructPoint(XCoordinate=pdecon.XComponent, YCoordinate=pdecon.YComponent, ZCoordinate=pdecon.ZComponent)
pt_5 = ConstructPoint(XCoordinate=addition_4, YCoordinate=pdecon.YComponent, ZCoordinate=pdecon.ZComponent)
pt_6 = ConstructPoint(XCoordinate=pdecon.XComponent, YCoordinate=addition_3, ZCoordinate=pdecon.ZComponent)
rec_3pt = Rectangle3Pt(PointA=pt_4, PointB=pt_5, PointC=pt_6)  # -> Rectangle, Length
addition_5 = Addition(A=item_7.Item1, B=Slider(3, range=0..10))
Z_3 = UnitZ(Factor=addition_5)
extr_4 = Extrude(Base=rec_3pt.Rectangle, Direction=Z_3)

# ---- group: Top Podium Floor
geo_3 = Geometry(move_2.Geometry)

# ----
basement_form = Brep(sunion)

# ---- group: Podium Form
geo_4 = Geometry(sdiff)

# ---- group: Building Core
geo_5 = Geometry(extr_4)

# ----
expression_5 = Expression(x=podium_floors, Expression="x+1")
split = SplitList(List=pt, Index=expression_5)  # -> ListA, ListB
split_2 = SplitList(List=split.ListB, Index=commercial_floors_count)  # -> ListA, ListB
# Commercial Area
panel_4 = Panel("-100 To 100")
# Office Area
planesrf = PlaneSurface(Plane=split_2.ListA, XSize="-100 To 100", YSize="-100 To 100")
# Residential Area
planesrf_2 = PlaneSurface(Plane=split_2.ListB, XSize="-100 To 100", YSize="-100 To 100")
planesrf_3 = PlaneSurface(Plane=split.ListA, XSize=panel_4, YSize=panel_4)
# Parking Area
planesrf_4 = PlaneSurface(Plane=merge_5, XSize="-100 To 100", YSize="-100 To 100")
edges = BrepEdges(Brep=planesrf)  # -> flatten(Naked), Interior, NonManifold
edges_2 = BrepEdges(Brep=planesrf_2)  # -> flatten(Naked), Interior, NonManifold
edges_3 = BrepEdges(Brep=planesrf_3)  # -> flatten(Naked), Interior, NonManifold
edges_4 = BrepEdges(Brep=planesrf_4)  # -> flatten(Naked), Interior, NonManifold
project = Project(Curve=edges.Naked, Brep=geo_5, Direction="{-1,1,0}")
project_2 = Project(Curve=edges.Naked, Brep=brep, Direction="{-1,1,0}")  # -> flatten(Curve)
project_3 = Project(Curve=edges_2.Naked, Brep=geo_5, Direction="{-1,1,0}")
project_4 = Project(Curve=edges_2.Naked, Brep=brep, Direction="{-1,1,0}")  # -> flatten(Curve)
project_5 = Project(Curve=edges_3.Naked, Brep=sdiff, Direction="{-1,1,0}")  # -> flatten(Curve)
project_6 = Project(Curve=edges_4.Naked, Brep=geo_5, Direction="{-1,1,0}")
project_7 = Project(Curve=edges_4.Naked, Brep=basement_form, Direction="{-1,1,0}")  # -> flatten(Curve)
boundary_4 = BoundarySurfaces(Edges=project_2)
boundary_5 = BoundarySurfaces(Edges=project_4)
boundary_6 = BoundarySurfaces(Edges=project_5)
boundary_7 = BoundarySurfaces(Edges=project_7)

offset_4 = OffsetCurve(Curve=project, Distance=corridor, Corners=1)
area_3 = Area(Geometry=boundary_4)  # -> Area, Centroid
preview = CustomPreview(Geometry=boundary_4, Material=ColourSwatch(SwatchColor=RGB(71, 186, 138)))
offset_5 = OffsetCurve(Curve=project_3, Distance=corridor, Corners=1)
area_4 = Area(Geometry=boundary_5)  # -> Area, Centroid
preview_2 = CustomPreview(Geometry=boundary_5, Material=ColourSwatch(SwatchColor=RGB(71, 148, 186)))
area_5 = Area(Geometry=boundary_6)  # -> Area, Centroid
preview_3 = CustomPreview(Geometry=boundary_6, Material=ColourSwatch(SwatchColor=RGB(201, 128, 0)))
offset_6 = OffsetCurve(Curve=project_6, Distance=corridor, Corners=1)
area_6 = Area(Geometry=boundary_7)  # -> Area, Centroid
preview_4 = CustomPreview(Geometry=boundary_7, Material=ColourSwatch(SwatchColor=RGB(186, 180, 71)))

panel_5 = Panel(area_5.Area)
panel_6 = Panel(area_6.Area)
panel_7 = Panel(area_3.Area)
panel_8 = Panel(area_4.Area)
merge_6 = Merge(Data1=area_5.Area, Data2=area_6.Area, Data3=area_3.Area, Data4=area_4.Area)
avr = Average(Input=area_3.Area)
avr_2 = Average(Input=area_3.Area)
ma = MassAddition(Input=merge_6)  # -> Result, PartialResults
ma_2 = MassAddition(Input=area_6.Area)  # -> Result, PartialResults
ma_3 = MassAddition(Input=area_5.Area)  # -> Result, PartialResults
ma_4 = MassAddition(Input=area_3.Area)  # -> Result, PartialResults
ma_5 = MassAddition(Input=area_4.Area)  # -> Result, PartialResults
round = Round(Number=avr)  # -> Nearest, Floor, Ceiling
multiplication = Multiplication(A="2.5", B="3")
swatch = ColourSwatch(SwatchColor=RGB(255, 255, 255))
pt_7 = Point(Point(10, 60, 0))
round_2 = Round(Number=ma.Result)  # -> Nearest, Floor, Ceiling
round_3 = Round(Number=ma_2.Result)  # -> Nearest, Floor, Ceiling
round_4 = Round(Number=ma_3.Result)  # -> Nearest, Floor, Ceiling
round_5 = Round(Number=ma_4.Result)  # -> Nearest, Floor, Ceiling
round_6 = Round(Number=ma_5.Result)  # -> Nearest, Floor, Ceiling
round_7 = Round(Number=avr_2)  # -> Nearest, Floor, Ceiling
Y = UnitY(Factor="2.5")
Y_2 = UnitY(Factor="2.5")
Y_3 = UnitY(Factor="2.5")
Y_4 = UnitY(Factor="2.5")
Y_5 = UnitY(Factor="2.5")
Y_6 = UnitY(Factor=multiplication)
concat = Concatenate(FragmentA="Average Hotel Footprint = ", FragmentB=round.Nearest, FragmentC=" m²")
move_5 = Move(Geometry=pt_7, Motion=expr("(x*-1)+{0,-2,0}", Y_2))  # -> Geometry, Transform
move_6 = Move(Geometry=move_5.Geometry, Motion=expr("(x*-1)+{0,-2,0}", Y_3))  # -> Geometry, Transform
move_7 = Move(Geometry=move_6.Geometry, Motion=expr("(x*-1)+{0,-2,0}", Y_4))  # -> Geometry, Transform
move_8 = Move(Geometry=move_7.Geometry, Motion=expr("(x*-1)+{0,-2,0}", Y_5))  # -> Geometry, Transform
move_9 = Move(Geometry=move_8.Geometry, Motion=expr("(x*-1)+{0,-2,0}", Y_6))  # -> Geometry, Transform
move_10 = Move(Geometry=move_9.Geometry, Motion=expr("(x*-1)+{0,-2,0}", Y))  # -> Geometry, Transform
concat_2 = Concatenate(FragmentA="Total Gross Floor Area = ", FragmentB=round_2.Nearest, FragmentC=" m²")
concat_3 = Concatenate(FragmentA="Total Parking Area = ", FragmentB=round_3.Nearest, FragmentC=" m²")
concat_4 = Concatenate(FragmentA="Total Commercial Area = ", FragmentB=round_4.Nearest, FragmentC=" m²")
concat_5 = Concatenate(FragmentA="Total Office Area = ", FragmentB=round_5.Nearest, FragmentC=" m²")
concat_6 = Concatenate(FragmentA="Total Residential Area = ", FragmentB=round_6.Nearest, FragmentC=" m²")
concat_7 = Concatenate(FragmentA="Average Office Footprint = ", FragmentB=round_7.Nearest, FragmentC=" m²")
tag = TextTag3D(Location=move_10.Geometry, Text=concat, Size="2.5", Colour=swatch, Justification=7)
tag_2 = TextTag3D(Location=pt_7, Text=concat_2, Size="3.2", Colour=ColourSwatch(SwatchColor=RGB(255, 157, 0)), Justification=7)
tag_3 = TextTag3D(Location=move_5.Geometry, Text=concat_3, Size="2.5", Colour=swatch, Justification=7)
tag_4 = TextTag3D(Location=move_6.Geometry, Text=concat_4, Size="2.5", Colour=swatch, Justification=7)
tag_5 = TextTag3D(Location=move_7.Geometry, Text=concat_5, Size="2.5", Colour=swatch, Justification=7)
tag_6 = TextTag3D(Location=move_8.Geometry, Text=concat_6, Size="2.5", Colour=swatch, Justification=7)
tag_7 = TextTag3D(Location=move_9.Geometry, Text=concat_7, Size="2.5", Colour=swatch, Justification=7)
