# Grasshopper definition RHINO.INSIDE_Learning.gh (Grasshopper 1.0.7)
# plug-ins: Rhino.Inside for Autodesk Revit, Bifocals

element = Element()
graphical_element = GraphicalElement(<floor referenced from the Revit model>)
group = Group()
edge = Edge([<edge referenced from the Revit model> x6])
sketch_plane = SketchPlane()
A = Assembly()
ceiling = Ceiling()
curtain_system = CurtainSystem()
host = Host()
panel = Panel()
wall = Wall()
category = Category()
family = Family()
line_pattern = LinePattern()
phase = Phase()
workset = Workset()
sheet = Sheet()
active_selection = Grid([<grid referenced from the Revit model> x12])
level = Level([<level referenced from the Revit model> x5])
face = Face(<face referenced from the Revit model>)
vertex = Vertex()
building_pad = BuildingPad()
curtain_grid_line = CurtainGridLine()
floor = Floor()
mullion = Mullion()
roof = Roof()
doc = Document()
fill_pattern = FillPattern(<fill pattern referenced from the Revit model>)
material = Material()
type = Type()
view = View()
parameter = Parameter()
fill_pattern_2 = FillPattern(<fill pattern referenced from the Revit model>)
# Select the floor design
panel_2 = Panel(edge)
panel_3 = Panel(fill_pattern_2)
assembly = AddAssembly(TrackingMode=2)
assemble = AssembleElements(TrackingMode=2)
disassemble = DisassembleAssembly()
members = AssemblyMembers()  # -> Assembly, Members
assemblies = QueryAssemblies()
crv = Curve(<curve referenced from the Rhino model>)
crv_2 = Curve([<curve referenced from the Rhino model> x3])
trigger = Trigger(Interval=-1000, TimerInterval=1000, Target=beam)
crv_3 = Curve(<curve referenced from the Rhino model>)
crv_4 = Curve(<curve referenced from the Rhino model>)
crv_5 = Curve(<curve referenced from the Rhino model>)
crv_6 = Curve(<curve referenced from the Rhino model>)
beam = AddBeam(Curve=crv, TrackingMode=2)
column = AddColumn(Curve=crv_2, TrackingMode=2)
compadap = AddComponentAdaptive(TrackingMode=2)
floor_2 = AddFloor(Boundary=crv_3, TrackingMode=2)
roof_2 = AddRoof(Boundary=crv_5, TrackingMode=2)
railing = AddRailing(Curve=crv_4, TrackingMode=2)
